# Grasshopper definition SynthAnthro_OpenMesh_1.gh (Grasshopper 1.0.8)

panel = Panel("SPRING")
list = ValueList({"MALE", "FEMALE"}, selected="MALE")
panel_2 = Panel("0001")
path = FilePath("/Users/briancox/Dropbox/GitHub/MTWABP/Tools/SyntheticAnthropometry/CAESAR/OBJ/")
panel_3 = Panel(path)
panel_4 = Panel(list)
path_2 = FilePath("/Users/briancox/Dropbox/GitHub/MTWABP/Tools/SyntheticAnthropometry/CAESAR/OBJ/SPRING_MALE/")
concat = Concatenate(FragmentA=path_2, FragmentB="SPRING0001.obj")
panel_5 = Panel(concat)
concat_2 = Concatenate()
_3dm = Import3DM(File=panel_5, Layer="*", Name="*")
scale = Scale(Geometry=_3dm, Center=Point(0, 0, 0), Factor=Slider(100, range=0..1000))  # -> Geometry, Transform
geo = Geometry(scale.Geometry)
subdmesh = SubDFromMesh(Mesh=geo, Creases=1, Corners=1, Interpolate=False)
